# Dynamo graph LOCALIZAÇÃOH_script.dyn (Dynamo 2.13.1.3887)

python_script = Python()  # IronPython2; unwired: IN[0]
# ---------- python_script.python (57 lines) ----------
#TEMPLATE Python Script by BIM Coder
#Versão 1.0 - 08/24

#---IMPORTAÇÕES
# Sistema e .NET
import clr
import sys
import System
from System import Array
from System.Collections.Generic import *

# Biblioteca de Geometria do Dynamo
clr.AddReference('ProtoGeometry')
from Autodesk.DesignScript.Geometry import *

# Nós do Dynamo
clr.AddReference('RevitNodes')
import Revit
clr.ImportExtensions(Revit.Elements)
clr.ImportExtensions(Revit.GeometryConversion)

# Documentos e Transações
clr.AddReference('RevitServices')
import RevitServices
from RevitServices.Persistence import DocumentManager
from RevitServices.Transactions import TransactionManager

# DB da API do Revit
import Autodesk
clr.AddReference('RevitAPI')
from Autodesk.Revit.DB import *

# Interface do usuário da API do Revit
clr.AddReference('RevitAPIUI')
from Autodesk.Revit.UI import *

from Autodesk.Revit.UI.Selection import ObjectType

# Documentos e Interfaces
doc = DocumentManager.Instance.CurrentDBDocument
uiapp = DocumentManager.Instance.CurrentUIApplication
app = uiapp.Application
uidoc = uiapp.ActiveUIDocument

#---CLASSES E FUNÇÕES

#---SCRIPT

# Solicitar ao usuário que selecione múltiplos objetos do tipo Element (por exemplo, paredes, janelas, etc.)

selected_references = uidoc.Selection.PickObjects(ObjectType.Element)

# Obter os elementos a partir das referências
selected_elements = [uidoc.Document.GetElement(reference) for reference in selected_references]

# Saída para o Dynamo (lista de elementos Revit)
OUT = selected_elements
# ----------------------------------------
python_script_2 = Python(IN[0]=python_script)  # IronPython2
# ---------- python_script_2.python (54 lines) ----------
import clr
clr.AddReference('RevitServices')
from RevitServices.Persistence import DocumentManager

clr.AddReference("RevitAPI")
from Autodesk.Revit.DB import *

# Função para listar os elementos principais e suas famílias aninhadas
def get_all_elements(element, collected_ids):
    element_list = []
    
    # Verificar se o elemento é uma instância de família ou um elemento de sistema (como Pipe)
    if isinstance(element, Element):  # Usando Element como verificação genérica
        # Adicionar o elemento principal à lista, se ainda não foi adicionado
        if element.Id not in collected_ids:
            element_list.append(element)
            collected_ids.add(element.Id)
        
        # Se o elemento for uma FamilyInstance, verificar subcomponentes
        if isinstance(element, FamilyInstance):
            sub_elements = element.GetSubComponentIds()
            if not sub_elements:
                return element_list
            
            # Se o elemento tiver subcomponentes, adicionar os aninhados
            for sub_elem_id in sub_elements:
                sub_elem = doc.GetElement(sub_elem_id)
                if isinstance(sub_elem, FamilyInstance) and sub_elem.Id not in collected_ids:
                    element_list.append(sub_elem)
                    collected_ids.add(sub_elem.Id)
                    # Recursivamente buscar subcomponentes dos aninhados
                    element_list.extend(get_all_elements(sub_elem, collected_ids))
    
    return element_list

# Coletando o documento ativo
doc = DocumentManager.Instance.CurrentDBDocument

# Entrada 0 - elementos selecionados
input_elements = UnwrapElement(IN[0])

# Inicializando a lista de todos os elementos (principais e aninhados)
all_elements = []

# Inicializando um conjunto para evitar duplicatas com base no ID dos elementos
collected_ids = set()

# Verificando todos os elementos e suas famílias aninhadas
for element in input_elements:
    if isinstance(element, Element):  # Verificação genérica de que o objeto é um elemento do Revit
        all_elements.extend(get_all_elements(element, collected_ids))

# Saída - lista de todos os elementos, incluindo principais e aninhados
OUT = all_elements
# ----------------------------------------
TEXTO = Python()  # IronPython2; unwired: IN[0]
# ---------- TEXTO.python (62 lines) ----------
import clr
clr.AddReference('System.Windows.Forms')
clr.AddReference('System.Drawing')

from System.Windows.Forms import Application, Form, Label, TextBox, Button, FormStartPosition
from System.Drawing import Point, Size, Color

class MyForm(Form):
    def __init__(self, theme='Dark'):
        # Configurações do Formulário
        self.Text = "Parâmetro ORÇAMENTO LOCALIZAÇÃO"
        self.Size = Size(350, 200)
        self.StartPosition = FormStartPosition.CenterScreen
        self.ShowIcon = False
        self.MaximizeBox = False
        self.MinimizeBox = False

        # Configuração do tema
        if theme == 'Light':
            self.BackColor = Color.White
            self.ForeColor = Color.Black
        else:
            self.BackColor = Color.FromArgb(45, 45, 48)  # Dark theme
            self.ForeColor = Color.White

        self.create_form()
        self.create_ok_button()

    def create_form(self):
        """Cria a Label e o campo de entrada de texto."""
        lbl = Label()
        lbl.Text = "Digite o texto:"
        lbl.Location = Point(20, 20)
        lbl.Size = Size(150, 30)
        self.Controls.Add(lbl)

        self.txt_input = TextBox()
        self.txt_input.Location = Point(20, 50)
        self.txt_input.Size = Size(240, 30)
        self.Controls.Add(self.txt_input)

    def create_ok_button(self):
        """Cria o botão OK para capturar o texto e fechar o formulário."""
        btn_ok = Button()
        btn_ok.Text = "OK"
        btn_ok.Location = Point((self.ClientSize.Width - 100) // 2, 90)
        btn_ok.Size = Size(100, 30)
        btn_ok.Click += self.on_ok
        self.Controls.Add(btn_ok)

    def on_ok(self, sender, event):
        """Captura o texto digitado e fecha o formulário."""
        self.user_input = self.txt_input.Text
        self.Close()

# Criação do formulário
theme = "Dark"  # Você pode mudar para "Light" se quiser o tema claro
form = MyForm(theme)
Application.Run(form)

# O texto inserido pelo usuário será armazenado na variável 'form.user_input'
OUT = form.user_input
# ----------------------------------------
preencher_o_parametro = Python(IN[0]=python_script_2, IN[1]=TEXTO)  # IronPython2
# ---------- preencher_o_parametro.python (30 lines) ----------
import clr
clr.AddReference('RevitServices')
clr.AddReference('RevitAPI')
clr.AddReference('RevitAPIUI')

from RevitServices.Persistence import DocumentManager
from RevitServices.Transactions import TransactionManager
from Autodesk.Revit.DB import Element

# Obter o documento ativo do Revit
doc = DocumentManager.Instance.CurrentDBDocument

# Obter os elementos selecionados a partir de IN[0] e o texto da IN[1]
elements = UnwrapElement(IN[0])  # Desembrulha os elementos do Dynamo
text_to_set = IN[1]  # Texto a ser inserido no parâmetro "ORÇAMENTO TIPO DE SISTEMA"

# Iniciar uma transação para modificar os parâmetros no Revit
TransactionManager.Instance.EnsureInTransaction(doc)

# Iterar sobre os elementos e definir o valor no parâmetro "ORÇAMENTO TIPO DE SISTEMA"
for element in elements:
    marca_param = element.LookupParameter("ORÇAMENTO LOCALIZAÇÃO")
    if marca_param and not marca_param.IsReadOnly:
        marca_param.Set(text_to_set)

# Finalizar a transação
TransactionManager.Instance.TransactionTaskDone()

# Saída
OUT = "Texto atualizado no parâmetro 'ORÇAMENTO LOCALIZAÇÃO' para {} elementos.".format(len(elements))
# ----------------------------------------
